# Dynamo graph Library to GraphML.dyn (Dynamo 2.19.3.6394)
# packages: Genius Loci 2024.5.29, Clockwork for Dynamo 2.x 2.6.0

# group: Packages
# note: you'll need these packages:
# GeniusLoci | v.2024.5.29
# Clockwork |

# group: How to
# note: just run the script on a list of families.
# you'll find the GraphML file in the script folder.
# to batch process you can use:
# DYNAMO MULTIPLAYER
# https://www.birdtools-developers.com/dmu.html
# DynaOne
# https://camilion.eu/product/revit-plugin-to-run-a-dynamo-script/
# Revit Batch Processor
# https://github.com/bvn-architecture/RevitBatchProcessor

# group: Data gathering and packing
# note: Annotation
python_script = Python()  # CPython3
# ---------- python_script.python (7 lines) ----------
import clr
clr.AddReference('DynamoServices')
from Dynamo.Events import *

scriptPath = ExecutionEvents.ActiveSession.CurrentWorkspacePath

OUT = scriptPath
# ----------------------------------------
code_block = CodeBlock()
# ---------- code_block.designscript (8 lines) ----------
[
"FamilyName",
"Category",
"IsShared",
"Directory",
"NestedFamilies",
"FileSize"
];
# ----------------------------------------
documents_properties = Custom[Documents Properties]()  # package Genius Loci; Queries the document properties. Works also with familyDocument
python_script_2 = Python()  # CPython3; unwired: IN[0]
# ---------- python_script_2.python (24 lines) ----------
import clr
clr.AddReference("RevitServices")
from RevitServices.Persistence import DocumentManager
from RevitServices.Transactions import TransactionManager

clr.AddReference("RevitAPI")
from Autodesk.Revit.DB import FilteredElementCollector, ElementClassFilter, FamilySymbol, Family

clr.AddReference("RevitNodes")
import Revit
from Revit.Elements import Element
clr.ImportExtensions(Revit.Elements)

family_document = DocumentManager.Instance.CurrentDBDocument  # Use the current document as fallback

# Collect families in document
filtered_elements = FilteredElementCollector(family_document) \
    .WherePasses(ElementClassFilter(Family)) \
    .ToElements()

dynamo_elements = [element.ToDSType(True) for element in filtered_elements]

# Output
OUT = dynamo_elements
# ----------------------------------------
deconstruct = List.Deconstruct(list=python_script_2)
family_properties = Custom[Family Properties](family=deconstruct.first)  # package Genius Loci; Queries the family properties. (IsInPlace, IsShared...)
string_from_object = FromObject(object=family_properties.Category)
code_block_2 = CodeBlock(a=family_properties.IsShared) { a=="Yes"?"true":"false"; }
directoryName = FileSystem.DirectoryName(path=documents_properties.FilePath)
all_elements_of_family = Custom[All Elements of Family](family=deconstruct.rest)  # package Genius Loci; Get the family instances of the given loadable family.
isEmpty = List.IsEmpty(list=all_elements_of_family@L2)
not_ = Not(x=isEmpty)
filterByBoolMask = List.FilterByBoolMask(list=deconstruct.rest, mask=not_)
name = Custom[Element.Name+](element=filterByBoolMask.in)  # package Clockwork for Dynamo 2.x; Gets an element's name. Unlike the OOTB node, this node should work for *all* Revit elements that have names and will also return the localized names of system parameters, parameter groups, display unit types, parameter types, unit symbol types, unit types and ForgeTypeIds.
uniqueItems = List.UniqueItems(list=name)
code_block_3 = CodeBlock { " MB"; ""; }
replace = String.Replace(string=documents_properties.FileSize, searchFor=code_block_3.out0, replaceWith=code_block_3.out1)
toNumber = String.ToNumber(string=replace)
list_create = List.Create(item0=documents_properties.FileName, item1=string_from_object, item2=code_block_2, item3=directoryName, item4=uniqueItems, item5=toNumber)
byKeysValues = DesignScript.Builtin.Dictionary.ByKeysValues(keys=code_block, values=list_create)

# group: graphml creation
directoryName_2 = FileSystem.DirectoryName(path=python_script)
python_script_3 = Python(IN[0]=directoryName_2, IN[1]=byKeysValues)  # CPython3
# ---------- python_script_3.python (122 lines) ----------
import os
import xml.etree.ElementTree as ET
import re

def get_or_create_family_map(path, mapFilename):
    file_path = os.path.join(path, mapFilename)
    
    if not os.path.isfile(file_path):
        root = ET.Element('graphml') 
        keys = [
            {"attr.name": "FileSize", "attr.type": "double", "for": "node", "id": "FileSize"},
            {"attr.name": "FamilyName", "attr.type": "string", "for": "node", "id": "FamilyName"},
            {"attr.name": "IsShared", "attr.type": "boolean", "for": "node", "id": "IsShared"},
            {"attr.name": "Category", "attr.type": "string", "for": "node", "id": "Category"},
            {"attr.name": "Directory", "attr.type": "string", "for": "node", "id": "Directory"}
        ]
        for key in keys:
            ET.SubElement(root, 'key', key)
        
        graph = ET.SubElement(root, 'graph', edgedefault="undirected")
        tree = ET.ElementTree(root)
    else:
        tree = ET.parse(file_path)
        root = tree.getroot()
    return tree, root

def check_xml_element_with_xpath(root, xpath, property_name, property_value):
    for elem in root.findall(xpath):
        if elem.attrib.get(property_name) == property_value:
            return True
    return False

def check_nested_xml_element_with_xpath(root, parent_xpath, parent_property, parent_value, child_xpath, child_property, child_value):
    for parent in root.findall(parent_xpath):
        if parent.attrib.get(parent_property) == parent_value:
            for child in parent.findall(child_xpath):
                if child.attrib.get(child_property) == child_value:
                    return True
    return False

def create_xml_element_with_xpath(root, xpath, element_name, property_name, property_value):
    path_parts = xpath.strip('/').split('/')
    current_element = root
    for part in path_parts:
        next_element = current_element.find(part)
        if next_element is None:
            next_element = ET.SubElement(current_element, part)
        current_element = next_element
    new_element = ET.SubElement(current_element, element_name)
    new_element.set(property_name, property_value)
    return root

def create_xml_element_by_id(root, parent_element_tag, parent_id, element_name, properties, text_value=None):
    parent_element = None
    for elem in root.findall(".//"+parent_element_tag+"[@id='"+parent_id+"']"):
        parent_element = elem
        break
    
    if parent_element is not None:
        new_element = ET.SubElement(parent_element, element_name)
        
        for key, value in properties.items():
            new_element.set(key, value)
        
        if text_value:
            new_element.text = text_value
        
        return root
    else:
        print(f"Element with id '{parent_id}' not found.")
        return root   

def add_properties_to_element_by_id(root, element_id, id_attribute, properties):
    for elem in root.iter():
        if elem.attrib.get(id_attribute) == element_id:
            elem.attrib.update(properties)
            break
    return root

#inputs
script_path = IN[0]
family_data = IN[1]

#main variables
map_filename = "FamilyMap.graphml"
map_path = os.path.join(script_path, map_filename)
nested_families = family_data["NestedFamilies"]
self_node_id = family_data["FamilyName"]

tree, root = get_or_create_family_map(script_path, map_filename)
root_graphml = root
graph_element = root.find("graph")

#graphML logic
# first let's  create nested families nodes if they don't exist yet

for nf in nested_families:
    if not check_xml_element_with_xpath(root, ".//node", "id", nf):
        new_node = ET.SubElement(graph_element, "node", id=nf)

#then let's do the same for the current doc family, if exists let's populate the data
nodeExists = check_xml_element_with_xpath(root, ".//node", "id", self_node_id)
if not nodeExists:
    new_node = ET.SubElement(graph_element, "node", id=self_node_id)
    for k in family_data.keys():
        root = create_xml_element_by_id(root, "node", self_node_id, "data", {"key": k}, str(family_data[k]))
else:
    for k in family_data.keys():
        node_data_exists = check_nested_xml_element_with_xpath(root, "./graphml/graph/node", "id", self_node_id, ".//data", "key", k)
        if not node_data_exists:
            root = create_xml_element_by_id(root, "node", self_node_id, "data", {"key": k}, str(family_data[k]))

#now that we have all the nodes, let's create all the needed edges
for nf in nested_families:
    edge_id = nf+"_to_"+self_node_id
    new_edge =  ET.SubElement(graph_element, 'edge', id=edge_id)
    root = add_properties_to_element_by_id(root, edge_id, "id", {"source": nf, "target":self_node_id})

#let's convert everything to string (we'll write the xml with OOTB dynamo nodes)
xml_string = ET.tostring(root, encoding="unicode")

OUT = [xml_string, map_path]
# ----------------------------------------
code_block_4 = CodeBlock(a=python_script_3) { a[0]; a[1]; }
python_script_4 = Python(IN[0]=code_block_4.out0)  # CPython3
# ---------- python_script_4.python (42 lines) ----------
import clr
clr.AddReference('System.Xml')
clr.AddReference('System.Xml.Linq')

from System.Xml import XmlWriter, XmlWriterSettings
from System.Xml.Linq import XDocument

# Input: xml_string (string)
# Ensure you pass your XML string as input to this script

xml_string = IN[0]  # Get the XML string input

def beautify_xml(xml_string):
    try:
        # Parse the XML string into an XDocument
        doc = XDocument.Parse(xml_string)
        
        # Create settings for the XML writer to enable pretty-printing
        settings = XmlWriterSettings()
        settings.Indent = True
        settings.IndentChars = '  '
        settings.NewLineOnAttributes = False
        settings.OmitXmlDeclaration = True

        # Use a StringWriter to capture the beautified XML
        from System.IO import StringWriter
        string_writer = StringWriter()
        xml_writer = XmlWriter.Create(string_writer, settings)

        # Save the XDocument to the XML writer
        doc.Save(xml_writer)
        xml_writer.Close()

        # Return the beautified XML string
        return string_writer.ToString()
    except Exception as e:
        return str(e)

beautified_xml = beautify_xml(xml_string)

# Output the beautified XML
OUT = beautified_xml
# ----------------------------------------
writeText = FileSystem.WriteText(filePath=code_block_4.out1, text=python_script_4)
